# Grasshopper definition WK1 trial 1.ghx (Grasshopper 1.0.7)

point = Point([<point referenced from the Rhino model> x14])
# CONSTRUCT DOMAIN:
# control the maximum and minmum para
construct_domain = ConstructDomain(DomainStart=Slider(14, range=0..100), DomainEnd=Slider(67, range=0..100))
list_length = ListLength(List=point)
number_slider = Slider(11, range=0..100)
random = Random(Range=construct_domain, Number=list_length, Seed=2)
# TREE：
# apply to all objects
graft_tree = GraftTree(Tree=point, IncludeEmptyLists=True, IncludeNullItems=True)
graft_tree_2 = GraftTree(Tree=random, IncludeEmptyLists=True, IncludeNullItems=True)
# hold shift and select mutiple mumber sliders can link more
# hold ctrl+shift+left or right=choose everything connected with it
# control+shift and then click lines, you can move a bunch of cable to another battery.
number_slider_2 = Slider(0.021, range=0..1)
circle_cnr = CircleCNR(Center=graft_tree, Normal=Vector(0, 0, 1), Radius=graft_tree_2)
circle_cnr_2 = CircleCNR(Center=graft_tree, Normal=Vector(0, 0, 1), Radius=Slider(7, range=0..10))
# wants percentage, use reparameterize
evaluate_curve = EvaluateCurve(Curve=reparameterize(circle_cnr), Parameter=[Slider(0.166, range=0..1), number_slider_2])  # -> Point, Tangent, Angle
line = Line(StartPoint=graft_tree, EndPoint=evaluate_curve.Point)
# LIST LENGTH can read a range that has been chosen, connect with number of RANDOM to read the range(length)
list_length_2 = ListLength(List=point)
number_slider_3 = Slider(157, range=0..360)
number_slider_4 = Slider(56, range=0..100)
# TRIM WITH REGIONS:
# If trim, the region is the inner Circle CNR, use it to cut the line that generated by Evaluate Curve. In the end, you have to hide the TRIM, LINE and EVALUATE CURVE, then you can only see the new CURVE that you just generated and connected with TRIM. If don't hide, you cannot see the result.
trim_with_regions = TrimWithRegions(Curve=line, Regions=circle_cnr_2)  # -> Inside, Outside
curve = Curve(trim_with_regions.Outside)
# Randomly generated by Angle
# Seed is same as Mincraft to generate a world
random_2 = Random(Range="360", Number=list_length_2, Seed="666")
shift_paths = ShiftPaths(Data=curve, Offset="-1")
# Angle, change the order to degrees. It can rotate by refering certain degree (360)
rotate = Rotate(Geometry=shift_paths, Angle=degrees(random_2), Plane=graft_tree)  # -> Geometry, Transform
panel = Panel(random_2)
